# Dynamo graph Civil3D_Export_Chainage Northing Easting and Elevation from Profile.dyn (Dynamo 3.2.2.5494)

# group: Pilecap Points
current = Autodesk.AutoCAD.DynamoNodes.Document.Current()
alignments = Alignments(document=current)
file_path = Filename("..\..\..\..\..\..\209. ULCCS BIM Training & Implementation\3. Training Documents\4. Bridge\Excel Input\Revit Input\Pilecap_Revit_input.csv")
code_block = CodeBlock { ["Station","Easting","Northing","Pilecap TL","family type","Pile depth","Mark"]; }
file_path_2 = Filename("..\..\..\..\..\..\209. ULCCS BIM Training & Implementation\3. Training Documents\4. Bridge\Excel Input\Civil 3D Input\pilecap_coordinates_civil3d_input.csv")
boolean = BoolSelector(true)
importCSV = Data.ImportCSV(filePath=file_path_2, transpose=boolean)
code_block_2 = CodeBlock { 1; 0; }
dropItems = List.DropItems(list=importCSV, amount=code_block_2.out0)
transpose = List.Transpose(lists=dropItems)
pilecap_station = List.GetItemAtIndex(list=transpose, index=code_block_2.out1)
code_block_3 = CodeBlock { 1; }
flatten = List.Flatten(list=pilecap_station, amount=code_block_3)
alignment_name = CodeBlock { "Bridge"; }
alignmentByName = Autodesk.Civil.DynamoNodes.Selection.AlignmentByName(name=alignment_name, document=current)
coordinateSystemByStationOffset = Autodesk.Civil.DynamoNodes.Alignment.CoordinateSystemByStationOffset(alignment=alignmentByName, station=pilecap_station)
byCartesianCoordinates = Point.ByCartesianCoordinates(coordinateSystem=coordinateSystemByStationOffset)
code_block_4 = CodeBlock { 1; }
flatten_2 = List.Flatten(list=byCartesianCoordinates, amount=code_block_4)
X = Point.X(point=flatten_2)
Y = Point.Y(point=flatten_2)
list_create = List.Create(item0=flatten, item1=X, item2=Y)
code_block_5 = CodeBlock { 1..4; }
getItemAtIndex = List.GetItemAtIndex(list=transpose, index=code_block_5)
join = List.Join(list0=list_create, list1=getItemAtIndex)
transpose_2 = List.Transpose(lists=join)
addItemToFront = List.AddItemToFront(item=code_block, list=transpose_2)
exportCSV = Data.ExportCSV(filePath=file_path, data=addItemToFront)  # graph output
