# Dynamo graph Revit_ Change Family Type Parameter values to CAPSLOCK.dyn "Change Doors, WIndows-Type Parameter to CAPSLOCK" (Dynamo 2.19.3.6394)

# group: Input
n2_enter_parameter_name = StringInput("Type Mark")  # "2. Enter Parameter Name"; graph input

# group: Input
n1_select_category = Categories("OST_Walls")  # "1. Select Category"; graph input

all_elements_of_category = ElementsOfCategory(Category=n1_select_category)
elementType = Element.ElementType(element=all_elements_of_category)
getParameterValueByName = Element.GetParameterValueByName(element=elementType, parameterName=n2_enter_parameter_name)
boolean = BoolSelector(true)
changeCase = String.ChangeCase(string=getParameterValueByName, upper=boolean)
setParameterByName = Element.SetParameterByName(element=elementType, parameterName=n2_enter_parameter_name, value=changeCase)
getParameterValueByName_2 = Element.GetParameterValueByName(element=setParameterByName, parameterName=n2_enter_parameter_name)
code_block = CodeBlock(B=n2_enter_parameter_name, C=getParameterValueByName_2) { B + " :" + C; }
output = Watch(code_block)  # graph output
