# Dynamo graph Revit_Add Element ID parameter to all Elements.dyn "Add Element ID parameter" (Dynamo 2.19.3.6394)

n1_choose_category = Categories("OST_Casework")  # "1. Choose Category"; graph input
list_create = List.Create(item0=n1_choose_category)
all_elements_of_category = ElementsOfCategory(Category=list_create)
n2_enter_parameter_name = StringInput("Element ID")  # "2. Enter Parameter Name"; graph input
id = Element.Id(element=all_elements_of_category)
string_from_object = FromObject(object=id)
setParameterByName = Element.SetParameterByName(element=all_elements_of_category, parameterName=n2_enter_parameter_name, value=string_from_object)
OUTPUT = Watch(setParameterByName)  # graph output
n0_prerequisites = StringInput("1. Create an instance parameter to the respective categories named \" Element ID\". (Element ID).")  # "0. Prerequisites"; graph input
