# Dynamo graph Revit_Add Finishes Properties to Rooms.dyn "Add Finishes to Room" (Dynamo 2.19.3.6394)

categories = Categories("OST_Rooms")
all_elements_of_category = ElementsOfCategory(Category=categories)
code_block = CodeBlock { "Name"; }
getParameterValueByName = Element.GetParameterValueByName(element=all_elements_of_category, parameterName=code_block)
n1_1_file_path = Filename("..\..\..\..\Downloads\Dynamo Test.xlsx")  # "1.1 File Path*"; graph input
file_from_path = FileObject(path=n1_1_file_path)
n1_2_sheet_name = StringInput("Sheet1")  # "1.2. Sheet Name*"; graph input
importExcel = Data.ImportExcel(file=file_from_path, sheetName=n1_2_sheet_name)
code_block_2 = CodeBlock { 1; }
dropItems = List.DropItems(list=importExcel, amount=code_block_2)
transpose = List.Transpose(lists=dropItems)

# group: Floor Finish Data
n2_1_floor_finish_paramter_name = StringInput("")  # "2.1 Floor Finish Paramter Name"; graph input
n3_1_floor_finish_cell_no = DoubleInput(0)  # "3.1 Floor Finish Cell No:"; graph input
getItemAtIndex = List.GetItemAtIndex(list=transpose, index=n3_1_floor_finish_cell_no)
string_from_object = FromObject(object=getItemAtIndex)
setParameterByName = Element.SetParameterByName(element=all_elements_of_category, parameterName=n2_1_floor_finish_paramter_name, value=string_from_object)

getParameterValueByName_2 = Element.GetParameterValueByName(element=setParameterByName, parameterName=n2_1_floor_finish_paramter_name)
code_block_3 = CodeBlock(A=getParameterValueByName, B=getParameterValueByName_2) { A+" - " + B; }
n1_floor_finish = Watch(code_block_3)  # "1. Floor Finish"; graph output

# group: Skirting Finish Data
n2_2_skirting_finish_parameter = StringInput("")  # "2.2 Skirting Finish Parameter Name"; graph input
n3_2_skirting_finish_cell_no = DoubleInput(0)  # "3.2 Skirting Finish Cell No:"; graph input
getItemAtIndex_2 = List.GetItemAtIndex(list=transpose, index=n3_2_skirting_finish_cell_no)
string_from_object_2 = FromObject(object=getItemAtIndex_2)
setParameterByName_2 = Element.SetParameterByName(element=all_elements_of_category, parameterName=n2_2_skirting_finish_parameter, value=string_from_object_2)

getParameterValueByName_3 = Element.GetParameterValueByName(element=setParameterByName_2, parameterName=n2_2_skirting_finish_parameter)
code_block_4 = CodeBlock(A=getParameterValueByName, B=getParameterValueByName_3) { A+" - " + B; }
n2_skirting_finish = Watch(code_block_4)  # "2. Skirting Finish"; graph output

# group: Wall Cladding Data
n2_3_wall_finish_parameter_name = StringInput("")  # "2.3 Wall Finish Parameter Name"; graph input
n3_3_wall_finish_cell_no = DoubleInput(0)  # "3.3 Wall Finish Cell No:"; graph input
getItemAtIndex_3 = List.GetItemAtIndex(list=transpose, index=n3_3_wall_finish_cell_no)
string_from_object_3 = FromObject(object=getItemAtIndex_3)
setParameterByName_3 = Element.SetParameterByName(element=all_elements_of_category, parameterName=n2_3_wall_finish_parameter_name, value=string_from_object_3)

getParameterValueByName_4 = Element.GetParameterValueByName(element=setParameterByName_3, parameterName=n2_3_wall_finish_parameter_name)
code_block_5 = CodeBlock(A=getParameterValueByName, B=getParameterValueByName_4) { A+" - " + B; }
n3_wall_finish = Watch(code_block_5)  # "3. Wall Finish"; graph output

# group: False Ceiling Finish Data
n2_4_ceiling_finish_parameter = StringInput("Ceiling Finish")  # "2.4 Ceiling Finish Parameter Name"; graph input
n3_4_ceiling_finish_cell_no = DoubleInput(0)  # "3.4 Ceiling Finish Cell No:"; graph input
getItemAtIndex_4 = List.GetItemAtIndex(list=transpose, index=n3_4_ceiling_finish_cell_no)
string_from_object_4 = FromObject(object=getItemAtIndex_4)
setParameterByName_4 = Element.SetParameterByName(element=all_elements_of_category, parameterName=n2_4_ceiling_finish_parameter, value=string_from_object_4)

getParameterValueByName_5 = Element.GetParameterValueByName(element=setParameterByName_4, parameterName=n2_4_ceiling_finish_parameter)
code_block_6 = CodeBlock(A=getParameterValueByName, B=getParameterValueByName_5) { A+" - " + B; }
n4_ceiling_finish = Watch(code_block_6)  # "4. Ceiling Finish"; graph output

# group: Base Finish For Ceiling Data
n2_5_base_finish_for_ceiling = StringInput("")  # "2.5 Base Finish For Ceiling Parameter Name"; graph input
n3_5_base_finish_for_ceiling_cell = DoubleInput(1)  # "3.5 Base Finish For Ceiling Cell No:"; graph input
getItemAtIndex_5 = List.GetItemAtIndex(list=transpose, index=n3_5_base_finish_for_ceiling_cell)
string_from_object_5 = FromObject(object=getItemAtIndex_5)
setParameterByName_5 = Element.SetParameterByName(element=all_elements_of_category, parameterName=n2_5_base_finish_for_ceiling, value=string_from_object_5)

getParameterValueByName_6 = Element.GetParameterValueByName(element=setParameterByName_5, parameterName=n2_5_base_finish_for_ceiling)
code_block_7 = CodeBlock(A=getParameterValueByName, B=getParameterValueByName_6) { A+" - " + B; }
n5_base_finish_for_ceiling = Watch(code_block_7)  # "5. Base Finish For Ceiling"

# group: Base Finish For Wall Data
n2_6_base_finish_for_wall = StringInput("Base Finish")  # "2.6 Base Finish For Wall Parameter Name"; graph input
n3_6_base_finish_for_wall_cell_no = DoubleInput(1)  # "3.6 Base Finish For Wall Cell No:"; graph input
getItemAtIndex_6 = List.GetItemAtIndex(list=transpose, index=n3_6_base_finish_for_wall_cell_no)
string_from_object_6 = FromObject(object=getItemAtIndex_6)
setParameterByName_6 = Element.SetParameterByName(element=all_elements_of_category, parameterName=n2_6_base_finish_for_wall, value=string_from_object_6)

getParameterValueByName_7 = Element.GetParameterValueByName(element=setParameterByName_6, parameterName=n2_6_base_finish_for_wall)
code_block_8 = CodeBlock(A=getParameterValueByName, B=getParameterValueByName_7) { A+" - " + B; }
n6_base_finish_for_wall = Watch(code_block_8)  # "6. Base Finish For Wall"; graph output

# group: Painting Work For Wall Data
n2_7_painting_work_for_wall = StringInput("")  # "2.7 Painting Work For Wall Parameter Name"; graph input
n3_7_painting_work_for_wall_cell = DoubleInput(0)  # "3.7 Painting Work For Wall Cell No:"; graph input
getItemAtIndex_7 = List.GetItemAtIndex(list=transpose, index=n3_7_painting_work_for_wall_cell)
string_from_object_7 = FromObject(object=getItemAtIndex_7)
setParameterByName_7 = Element.SetParameterByName(element=all_elements_of_category, parameterName=n2_7_painting_work_for_wall, value=string_from_object_7)

getParameterValueByName_8 = Element.GetParameterValueByName(element=setParameterByName_7, parameterName=n2_7_painting_work_for_wall)
code_block_9 = CodeBlock(A=getParameterValueByName, B=getParameterValueByName_8) { A+" - " + B; }
n7_painting_work_for_wall = Watch(code_block_9)  # "7. Painting Work For Wall"; graph output

# group: Painting Work For Ceiling Data
n2_8_painting_work_for_ceiling = StringInput("")  # "2.8 Painting Work For Ceiling Parameter Name"; graph input
n3_8_painting_work_for_ceiling = DoubleInput(0)  # "3.8 Painting Work For Ceiling"; graph input
getItemAtIndex_8 = List.GetItemAtIndex(list=transpose, index=n3_8_painting_work_for_ceiling)
string_from_object_8 = FromObject(object=getItemAtIndex_8)
setParameterByName_8 = Element.SetParameterByName(element=all_elements_of_category, parameterName=n2_8_painting_work_for_ceiling, value=string_from_object_8)

getParameterValueByName_9 = Element.GetParameterValueByName(element=setParameterByName_8, parameterName=n2_8_painting_work_for_ceiling)
code_block_10 = CodeBlock(A=getParameterValueByName, B=getParameterValueByName_9) { A+" - " + B; }
n8_painting_work_for_ceiling = Watch(code_block_10)  # "8. Painting Work For Ceiling"; graph output

# group: Room Number Data
n2_9_room_number_parameter_name = StringInput("")  # "2.9 Room Number Parameter Name"; graph input
n3_9_room_number = DoubleInput(0)  # "3.9 Room Number"; graph input
getItemAtIndex_9 = List.GetItemAtIndex(list=transpose, index=n3_9_room_number)
string_from_object_9 = FromObject(object=getItemAtIndex_9)
setParameterByName_9 = Element.SetParameterByName(element=all_elements_of_category, parameterName=n2_9_room_number_parameter_name, value=string_from_object_9)

getParameterValueByName_10 = Element.GetParameterValueByName(element=setParameterByName_9, parameterName=n2_9_room_number_parameter_name)
code_block_11 = CodeBlock(A=getParameterValueByName, B=getParameterValueByName_10) { A+" - " + B; }
n9_room_number = Watch(code_block_11)  # "9. Room Number"; graph output
