# Dynamo graph Revit_Add Reinforcement Volume Parmeter (Thumb Rule).dyn "Add Reinforcement Volume Parmeter (Thumb Rule)" (Dynamo 2.19.3.6394)

n1_choose_category = Categories("OST_StructuralColumns")  # "1. Choose Category"; graph input
all_elements_of_category = ElementsOfCategory(Category=n1_choose_category)
n4_reinforcement_volume_parameter = StringInput("Reinforcement Volume")  # "4. Reinforcement Volume Parameter Name"; graph input
n2_volume_parameter_name = StringInput("Volume")  # "2. Volume Parameter Name"; graph input
getParameterValueByName = Element.GetParameterValueByName(element=all_elements_of_category, parameterName=n2_volume_parameter_name)
n3_multiplication_facator_thumb = DoubleInput(0.55)  # "3. Multiplication Facator (Thumb Rule)"; graph input
code_block = CodeBlock(X=getParameterValueByName, Y=n3_multiplication_facator_thumb) { X*Y; }
string_from_object = FromObject(object=code_block)
python_script = Python(IN[0]=string_from_object)  # CPython3
# ---------- python_script.python (14 lines) ----------
import math

# Input is a list of strings containing numbers
input_strings = IN[0]

# Function to round to 3 decimal places
def round_to_three_decimals(value):
    return f"{round(float(value), 3):.3f}"

# Process the list
output_list = [round_to_three_decimals(x) for x in input_strings]

# Output the list with numbers rounded to three decimal digits
OUT = output_list
# ----------------------------------------
code_block_2 = CodeBlock(X=python_script) { X+ " m3"; }
setParameterByName = Element.SetParameterByName(element=all_elements_of_category, parameterName=n4_reinforcement_volume_parameter, value=code_block_2)
getParameterValueByName_2 = Element.GetParameterValueByName(element=setParameterByName, parameterName=n4_reinforcement_volume_parameter)
code_block_3 = CodeBlock(X=setParameterByName, Y=getParameterValueByName_2) { X + " - Reinforcement Volume - " + Y; }
reinforcement_volume = Watch(code_block_3)  # graph output
