# Dynamo graph Revit_AddSimulation ID parameter.dyn "Simulation ID parameter" (Dynamo 2.16.2.5624)

# group: Select Elements
categories = Categories("OST_Parts")
all_elements_of_category = ElementsOfCategory(Category=categories)

# group: Location Filter
code_block = CodeBlock { "Location"; }
getParameterValueByName = Element.GetParameterValueByName(element=all_elements_of_category, parameterName=code_block)
code_block_2 = CodeBlock(i=getParameterValueByName) { i == "NorthSide(10+700to13+500)"; }
filterByBoolMask = List.FilterByBoolMask(list=all_elements_of_category, mask=code_block_2)

# group: Activity Filter
code_block_3 = CodeBlock { "Name"; }
getParameterValueByName_2 = Element.GetParameterValueByName(element=filterByBoolMask.in, parameterName=code_block_3)
code_block_4 = CodeBlock(i=getParameterValueByName_2) { i == "Precast of Columns and Panels"; }
filterByBoolMask_2 = List.FilterByBoolMask(list=filterByBoolMask.in, mask=code_block_4)

countTrue = List.CountTrue(list=code_block_4)

# group: Simulation ID - 01
code_block_5 = CodeBlock { "Simulation ID - 01"; }
code_block_6 = CodeBlock { "IC-A-CON-BW-OTH-CIV"; }
setParameterByName = Element.SetParameterByName(element=filterByBoolMask_2.in, parameterName=code_block_5, value=code_block_6)  # frozen

# group: Simulation ID - A
code_block_7 = CodeBlock { "Simulation ID - A"; }
code_block_8 = CodeBlock { "CF_N"; }
setParameterByName_2 = Element.SetParameterByName(element=filterByBoolMask_2.in, parameterName=code_block_7, value=code_block_8)  # frozen

# group: Simulation ID - 02
code_block_9 = CodeBlock { "Simulation ID - 02"; }
code_block_10 = CodeBlock { "IC-A-CON-BW-OTH-CIV-CF_N"; }
setParameterByName_3 = Element.SetParameterByName(element=filterByBoolMask_2.in, parameterName=code_block_9, value=code_block_10)  # frozen

# group: Simulation ID - B
code_block_11 = CodeBlock { "Simulation ID - B"; }
code_block_12 = CodeBlock { "ECP"; }
setParameterByName_4 = Element.SetParameterByName(element=filterByBoolMask_2.in, parameterName=code_block_11, value=code_block_12)

# group: Simulation ID - 03
code_block_13 = CodeBlock { "Simulation ID - 03"; }
code_block_14 = CodeBlock { "IC-A-CON-BW-OTH-CIV-BW_N1-ECP"; }
setParameterByName_5 = Element.SetParameterByName(element=filterByBoolMask_2.in, parameterName=code_block_13, value=code_block_14)

# group: Select Elements
categories_2 = Categories("OST_StructConnections")
all_elements_of_category_2 = ElementsOfCategory(Category=categories_2)  # frozen

# group: Location Filter
code_block_15 = CodeBlock { "Location"; }
getParameterValueByName_3 = Element.GetParameterValueByName(element=all_elements_of_category_2, parameterName=code_block_15)
code_block_16 = CodeBlock(i=getParameterValueByName_3) { i == "NorthSide(10+700to13+500)"; }
filterByBoolMask_3 = List.FilterByBoolMask(list=all_elements_of_category_2, mask=code_block_16)

# group: Activity Filter
code_block_17 = CodeBlock { "Name"; }
getParameterValueByName_4 = Element.GetParameterValueByName(element=filterByBoolMask_3.in, parameterName=code_block_17)
code_block_18 = CodeBlock(i=getParameterValueByName_4) { i == "Concertina coil placing"; }
filterByBoolMask_4 = List.FilterByBoolMask(list=filterByBoolMask_3.in, mask=code_block_18)

# group: Simulation ID - 01
code_block_19 = CodeBlock { "Simulation ID - 01"; }
code_block_20 = CodeBlock { "IC-A-CON-BW-OTH-CIV"; }
setParameterByName_6 = Element.SetParameterByName(element=filterByBoolMask_4.in, parameterName=code_block_19, value=code_block_20)  # frozen

# group: Simulation ID - 02
code_block_21 = CodeBlock { "Simulation ID - 02"; }
code_block_22 = CodeBlock { "IC-A-CON-BW-OTH-CIV-CF_N"; }
setParameterByName_7 = Element.SetParameterByName(element=filterByBoolMask_4.in, parameterName=code_block_21, value=code_block_22)  # frozen

# group: Simulation ID - B
code_block_23 = CodeBlock { "Simulation ID - B"; }
code_block_24 = CodeBlock { "CCP"; }
setParameterByName_8 = Element.SetParameterByName(element=filterByBoolMask_4.in, parameterName=code_block_23, value=code_block_24)  # frozen

# group: Simulation ID - A
code_block_25 = CodeBlock { "Simulation ID - A"; }
code_block_26 = CodeBlock { "CF_N"; }
setParameterByName_9 = Element.SetParameterByName(element=filterByBoolMask_4.in, parameterName=code_block_25, value=code_block_26)  # frozen

# group: Simulation ID - 03
code_block_27 = CodeBlock { "Simulation ID - 03"; }
code_block_28 = CodeBlock { "IC-A-CON-BW-OTH-CIV-CF_N-CCP"; }
setParameterByName_10 = Element.SetParameterByName(element=filterByBoolMask_4.in, parameterName=code_block_27, value=code_block_28)  # frozen
