# Dynamo graph Revit_BulkUpgradeRevitFiles.dyn "4.1 bulkUpgradeRevitFiles" (Dynamo 2.19.3.6394)
# Upgrade Revit versions of multiple files together. (keep all Revit files in one folder) *Script is applicable only for local files.
# packages: Rhythm 2020.1.24

# group: Provided with the Following License
# note: GNU License
# This program is free software: you can redistribute it and/or modify it under the terms of the GNU General Public License as published by the Free Software Foundation, either version 3 of the License, or (at your option) any later version.
# This program is distributed in the hope that it will be useful, but WITHOUT ANY WARRANTY; without even the implied warranty of MERCHANTABILITY or FITNESS FOR A PARTICULAR PURPOSE. See the GNU General Public License for more details.
# You should have received a copy of the GNU General Public License along with this program. If not, see http://www.gnu.org/licenses/

# group: How to Use:
# note: This file will upgrade the selected Revit files from a directory to THIS version of Revit that Dynamo is being ran on.

# group: Select your path of files
directory_path = Directory("C:\Users\User\Downloads\Revit upgrade dynamo")

# group: Obtain all .rvt files from the given path
directory_from_path = DirectoryObject(path=directory_path)
code_block = CodeBlock { "*.rvt"; }
getDirectoryContents = FileSystem.GetDirectoryContents(directory=directory_from_path, searchString=code_block)

# group: open the document in memory and save it
ʳʰʸᵗʰᵐ_applications = Rhythm.Revit.Application.Applications.OpenDocumentFile(filePath=getDirectoryContents.files)
boolean = BoolSelector(true)
ʳʰʸᵗʰᵐ_applications_2 = Rhythm.Revit.Application.Applications.CloseDocument(document=ʳʰʸᵗʰᵐ_applications, save=boolean)

# group: ***
mul = StringInput("""# Author: *

# Checked & Modified By : Jan 15, 2025

# Date: Jan 11, 2025""")

run_the_script = BoolSelector(true)  # graph input
