# Dynamo graph Revit_CAD Line to Pipe.dyn "1.9 CAD Line to Pipe" (Dynamo 2.19.3.6394)
# CAD Lines to Pipe Elements: (CAD pipe lines should be in same Layer)
# packages: DynaMEP 2.0.1, bimorphNodes 5.1.3, MEPover 2024.9.25, LinkDWG2 0.4.18

getCadLinked = CAD.CADLinked.GetCadLinked()
curvesFromCADLayers = CAD.CurvesFromCADLayers(importInstance=getCadLinked.importinstance)
importGeometries = Custom[ImportGeometries](importInstance=getCadLinked.importinstance)  # package LinkDWG2; Import basic lines and curves in ImporttantInstance into Dynamo with color-display option
code_block = CodeBlock(x=importGeometries.1_Dynamo_Geoms) { x; }
curves = PolyCurve.Curves(polyCurve=code_block)
flatten = List.Flatten(list=curves)
allPipeTypes = MEP.Pipes.AllPipeTypes()
code_block_2 = CodeBlock(i=allPipeTypes.PipeTypes) { i[0]; }
allSystemtype = MEP.Pipes.AllSystemtype()
code_block_3 = CodeBlock(i=allSystemtype.system_type) { i[0]; }
levels = Levels("Level 0")
code_block_4 = CodeBlock { 120; }
byLines = Custom[Pipe.ByLines](Lines=flatten, PipeType=code_block_2, SystemType=code_block_3, level=levels, Diameter=code_block_4)  # frozen; package MEPover; Creates a pipe by Line, PipeType, SystemType, Level and Diameter
python_script = Python(IN[0]=flatten, IN[1]=code_block_2, IN[2]=code_block_3, IN[3]=levels, IN[4]=code_block_4)  # CPython3
# ---------- python_script.python (128 lines) ----------
import clr

# Import Revit Services
clr.AddReference("RevitServices")
import RevitServices
from RevitServices.Persistence import DocumentManager
from RevitServices.Transactions import TransactionManager
doc = DocumentManager.Instance.CurrentDBDocument

# Import Revit API
clr.AddReference("RevitAPI")
import Autodesk
from Autodesk.Revit.DB import *

# Import Revit Nodes for Dynamo conversion
clr.AddReference("RevitNodes")
import Revit
clr.ImportExtensions(Revit.Elements)
clr.ImportExtensions(Revit.GeometryConversion)

# Process input lines
if isinstance(IN[0], list):
    lines = IN[0]
else:
    lines = [IN[0]]

# Extract start and end points of lines
FirstPoint = [x.StartPoint for x in lines]
SecondPoint = [x.EndPoint for x in lines]

# Process Pipe Type input
if isinstance(IN[1], list):
    pipetype = [UnwrapElement(x) for x in IN[1]]
else:
    pipetype = [UnwrapElement(IN[1])]
ptl = len(pipetype)

# Process System Type input
if isinstance(IN[2], list):
    systemtype = [UnwrapElement(x) for x in IN[2]]
else:
    systemtype = [UnwrapElement(IN[2])]
stl = len(systemtype)

# Process Level input
if isinstance(IN[3], list):
    level = [UnwrapElement(x) for x in IN[3]]
else:
    level = [UnwrapElement(IN[3])]
ll = len(level)

# Process Diameter input
if isinstance(IN[4], list):
    diameter = IN[4]
else:
    diameter = [IN[4]]
dl = len(diameter)

# List to store created elements (pipes + fittings)
elements = []

# Start Transaction
TransactionManager.Instance.EnsureInTransaction(doc)

# Store pipe elements to check for intersections
created_pipes = []

for i, x in enumerate(FirstPoint):
    try:
        # Get corresponding inputs for this pipe
        levelid = level[i % ll].Id
        systypeid = systemtype[i % stl].Id
        pipetypeid = pipetype[i % ptl].Id
        diam = diameter[i % dl]
        
        # Create Pipe
        pipe = Autodesk.Revit.DB.Plumbing.Pipe.Create(doc, systypeid, pipetypeid, levelid, x.ToXyz(), SecondPoint[i].ToXyz())
        
        # Set diameter parameter
        param = pipe.get_Parameter(BuiltInParameter.RBS_PIPE_DIAMETER_PARAM)
        param.SetValueString(str(diam))
        
        # Append created pipe to the list for future intersection checks
        created_pipes.append(pipe)
        
        # Check for intersections with previously created pipes and add fittings at junctions
        for created_pipe in created_pipes[:-1]:
            if pipe.Intersects(created_pipe):
                # Add a fitting (e.g., elbow or tee) at the intersection
                fitting_type = doc.GetElement(pipetypeid)  # Use the pipe type as a reference for fitting type
                fitting = CreatePipeFitting(doc, created_pipe, pipe)
                elements.append(fitting)
        
        # Append the converted pipe to the output list
        elements.append(pipe.ToDSType(False))
    
    except Exception as e:
        # Append None for failed pipe creation and log the error
        elements.append(None)
        print(f"Error at index {i}: {e}")

# Commit Transaction
TransactionManager.Instance.TransactionTaskDone()

# Filter out None values from the output
elements = [e for e in elements if e is not None]

# Output the created elements
OUT = elements


# Function to create pipe fittings at junctions (simple example with elbow)
def CreatePipeFitting(doc, pipe1, pipe2):
    # Check if both pipes are valid and create an elbow fitting at the intersection
    try:
        # In reality, you would need logic to create the correct fitting based on pipe types and orientation
        fitting_type = doc.GetElement(pipe1.GetTypeId())  # This should get the fitting type (e.g., elbow)
        
        # For simplicity, we'll assume you create an elbow fitting at the intersection point
        fitting_location = pipe1.GetEndPoint(1)  # Get the second endpoint of pipe1 as the intersection point
        
        # Create the fitting at the intersection location (this is simplified and should be customized)
        fitting = Autodesk.Revit.DB.Plumbing.PipeFitting.Create(doc, fitting_type, fitting_location)
        
        return fitting
    except Exception as e:
        print(f"Error creating fitting: {e}")
        return None
# ----------------------------------------
pipe_list = Watch(python_script)  # graph output
run_the_script = BoolSelector(true)  # graph input
