# Dynamo graph Revit_CADtofloorfinish.dyn "JPMC_CADtofloorfinish" (Dynamo 2.3.1.11775)
# packages: LinkDWG2 0.4.18, Clockwork for Dynamo 2.x 2.3.0

select_cad = DSModelElementSelection()  # 1 picked in the model; graph input
# note: Custom Node: LinkDWG2 v.0.4.18
importGeometries = Custom[ImportGeometries](importInstance=select_cad)  # package LinkDWG2; Import basic lines and curves in ImporttantInstance into Dynamo with color-display option
groupByKey = List.GroupByKey(list=importGeometries.1_Dynamo_Geoms, keys=importGeometries.2_LayerNames)
polylines = Watch(groupByKey.groups)
layers = Watch(groupByKey.unique_keys)  # graph output
cad_layer_names = StringInput("0")  # graph input
code_block = CodeBlock { ","; }
split = String.Split(str=cad_layer_names, separator0=code_block)
code_block_2 = CodeBlock { true; }
contains = String.Contains(str=layers, searchFor=split, ignoreCase=code_block_2, lacing=CrossProduct)
# note: Custom Node: Clockwork v.2.3.0
anyTrue = Custom[Booleans.AnyTrue](seq=contains)  # package Clockwork for Dynamo 2.x; Returns true if any item in a list of booleans is true.
filterByBoolMask = List.FilterByBoolMask(list=polylines, mask=anyTrue)
flatten = List.Flatten(list=filterByBoolMask.in)
floor_types = FloorTypes("FFL-8.5mm-CP-01")  # graph input
levels = Levels("6TH OFFICE LEVEL")  # graph input
byOutlineTypeAndLevel = Floor.ByOutlineTypeAndLevel(outline=flatten, floorType=floor_types, level=levels, lacing=Longest)
floors_created = Watch(byOutlineTypeAndLevel)  # graph output
code_block_3 = CodeBlock { "Height Offset From Level"; }
height_offset = DoubleInput(188.5)  # graph input
setParameterByName = Element.SetParameterByName(element=floors_created, parameterName=code_block_3, value=height_offset)
boolean = BoolSelector(true)  # graph input
autoConfig = Custom[AutoConfig](Run=boolean)  # package LinkDWG2; Auto-config LinkDWG and write data in registry, only need to run for one time just after first installation of LinkDWG
