# Dynamo graph Revit_Change Instance parameters to CAPSLOCK.dyn "Change Levels,Sheets,View Names to Caps" (Dynamo 2.19.3.6394)

# group: Input
n1_select_category_levels_grids = Categories("OST_Levels")  # "1. Select Category(Levels/Grids/Sheets"; graph input

all_elements_of_category = ElementsOfCategory(Category=n1_select_category_levels_grids)

# group: Input
n2_parameter_name = StringInput("Name")  # "2. Parameter Name"; graph input

getParameterValueByName = Element.GetParameterValueByName(element=all_elements_of_category, parameterName=n2_parameter_name)
boolean = BoolSelector(true)
changeCase = String.ChangeCase(string=getParameterValueByName, upper=boolean)
setParameterByName = Element.SetParameterByName(element=all_elements_of_category, parameterName=n2_parameter_name, value=changeCase)
output = Watch(setParameterByName)  # graph output
