# Dynamo graph Revit_Create Floors from Room Boundaries.dyn "Create Floors from Room Boundaries" (Dynamo 2.19.3.6394)
# packages: Orchid 2.19.3.6373, Crumple 2024.4.3

# group: Prerequisites
string = StringInput("""Prerequisites

-> The Type Mark Property of Floors should Match
with Rooms FloorFinish Property
""")  # graph input

# group: Collect All Room Elements
code_block = CodeBlock { "Rooms"; }
byName = Category.ByName(name=code_block)
current = Document.Current()
activeView = Document.ActiveView(document=current)
all_elements_of_category_in_view = ElementsOfCategoryInView(Category=byName, View=activeView)

# group: Collect All Floor Types
categories = Categories("OST_Floors")
all_elements_of_category = ElementsOfCategory(Category=categories)
elementType = Element.ElementType(element=all_elements_of_category)

# group: Get Floor Properties
code_block_2 = CodeBlock { "Type Mark"; "Default Thickness"; }
getParameterValueByName = Element.GetParameterValueByName(element=elementType, parameterName=code_block_2.out0)
getParameterValueByName_2 = Element.GetParameterValueByName(element=elementType, parameterName=code_block_2.out1)

# group: Get Room Property
code_block_3 = CodeBlock { "Floor Finish"; }
getParameterValueByName_3 = Element.GetParameterValueByName(element=all_elements_of_category_in_view, parameterName=code_block_3)

contains = List.Contains(list=getParameterValueByName@L2, item=getParameterValueByName_3, lacing=Longest)
filterByBoolMask = List.FilterByBoolMask(list=all_elements_of_category_in_view, mask=contains)
finishBoundary = Room.FinishBoundary(room=filterByBoolMask.in)
filterByBoolMask_2 = List.FilterByBoolMask(list=getParameterValueByName_3, mask=contains)
indexOf = List.IndexOf(list=getParameterValueByName, element=filterByBoolMask_2.in)
getItemAtIndex = List.GetItemAtIndex(list=elementType, index=indexOf)
code_block_4 = CodeBlock { "Level"; }
getParameterValueByName_4 = Element.GetParameterValueByName(element=filterByBoolMask.in, parameterName=code_block_4)
byName_2 = Orchid.RevitProject.Datums.Level.ByName(name=getParameterValueByName_4)
getItemAtIndex_2 = List.GetItemAtIndex(list=getParameterValueByName_2, index=indexOf)
floors_create = Custom[© Floors.Create](curvelists=finishBoundary, floortypes=getItemAtIndex, levels=byName_2, offset=getItemAtIndex_2)  # package Crumple; A new method unique to Revit 2022 that enables floors via the sketch API to support internal loops. Will not work in previous versions, and works best when the curves are in the form of list of lists of curves in continuous order.

# group: Outputs
watch = Watch(floors_create.versionCheck)
watch_2 = Watch(floors_create.floors)

# group: Packages Used
code_block_5 = CodeBlock()
# ---------- code_block_5.designscript (2 lines) ----------
"
1. Crumble: Version: 2024.4.3";
# ----------------------------------------
