# Dynamo graph Revit_Create Sheet List.dyn "Create Sheet List" (Dynamo 2.19.3.6394)

n1_1_file_path = Filename("..\..\..\..\Downloads\Drawing List - AR (1).xlsx")  # "1.1 File Path"; graph input
file_from_path = FileObject(path=n1_1_file_path)
n1_2_sheet_name = StringInput("AR ")  # "1.2 Sheet Name"; graph input
importExcel = Data.ImportExcel(file=file_from_path, sheetName=n1_2_sheet_name)
n2_amount_of_rows_drop_from_the = DoubleInput(3)  # "2. Amount of Rows drop from the Sheet (eg:Heading Rows)"; graph input
droptItems = List.DropItems(list=importExcel, amount=n2_amount_of_rows_drop_from_the)  # "List.DroptItems"
transpose = List.Transpose(lists=droptItems)
n3_3_sheet_name_cell_index_no = DoubleInput(16)  # "3.3. Sheet Name Cell Index No:"; graph input
code_block = CodeBlock(L=transpose, B=n3_3_sheet_name_cell_index_no) { L[B]; }
n3_2_sheet_number_cell_index_no = DoubleInput(17)  # "3.2. Sheet Number Cell Index No:"; graph input
code_block_2 = CodeBlock(L=transpose, A=n3_2_sheet_number_cell_index_no) { L[A]; }
n3_1_choose_title_block_family = FamilyTypes("Title_Blocks_A1_Metric:Standard")  # "3.1. Choose Title Block Family Type"; graph input
byNameNumberTitleBlock = Sheet.ByNameNumberTitleBlock(sheetName=code_block, sheetNumber=code_block_2, titleBlockFamilyType=n3_1_choose_title_block_family)
a_1_parameter_name_eg_drawing = StringInput("Drawing Title")  # "A.1. Parameter Name (eg: Drawing Title)"; graph input
a_2_cell_index_no_for_paramter_a = DoubleInput(3)  # "A.2 Cell Index No: (for Paramter A.1)"; graph input
code_block_3 = CodeBlock(L=transpose, C=a_2_cell_index_no_for_paramter_a) { L[C]; }
setParameterByName = Element.SetParameterByName(element=byNameNumberTitleBlock, parameterName=a_1_parameter_name_eg_drawing, value=code_block_3)
watch = Watch(byNameNumberTitleBlock)
code_block_4 = CodeBlock(i=watch) { i.Name; }
code_block_5 = CodeBlock(i=code_block_4) { i == null; }
filterByBoolMask = List.FilterByBoolMask(list=code_block_4, mask=code_block_5)
code_block_6 = CodeBlock { 0; }
code_block_7 = CodeBlock { 23; }
remove = String.Remove(string=filterByBoolMask.out, startIndex=code_block_6, count=code_block_7)
code_block_8 = CodeBlock(A=remove, B=filterByBoolMask.out) { A+" - "+B; }
sheet_list = Watch(code_block_8)  # graph output
