# Dynamo graph Revit_Delete Unused Filteres.dyn "Remove all Filters whose visibility is OFF from Template" (Dynamo 2.19.3.6394)
# packages: Crumple 2024.4.3

audit_viewfilters = Custom[© Audit.ViewFilters]()  # package Crumple; Returns all view filters in the document which are not in use by views or view templates. If you set the purge to true, it will attempt to delete them also.
watch = Watch(audit_viewfilters.viewFilters)
python_script = Python()  # CPython3; unwired: IN[0]
# ---------- python_script.python (15 lines) ----------
import clr
clr.AddReference('RevitServices')
from RevitServices.Persistence import DocumentManager

clr.AddReference("RevitAPI")
from Autodesk.Revit.DB import FilterElement, FilteredElementCollector

# Get the current document
doc = DocumentManager.Instance.CurrentDBDocument

# Collect all filter elements in the document
filters = FilteredElementCollector(doc).OfClass(FilterElement).ToElements()

# Assign output
OUT = filters
# ----------------------------------------
code_block = CodeBlock(i=python_script) { i.Name; }
watch_2 = Watch(code_block)
collect_views = Custom[© Collect.Views]()  # package Crumple; Returns all views in a document. Excludes system views, templates, legends and schedule instances.
filters = View.Filters(view=collect_views)
code_block_2 = CodeBlock(i=filters) { i.Name; }
watch_3 = Watch(code_block_2)
flatten = List.Flatten(list=watch_3)
watch_4 = Watch(flatten)
python_script_2 = Python(IN[0]=watch_2, IN[1]=watch_4)  # CPython3
# ---------- python_script_2.python (11 lines) ----------
# Input 1: AllFilters (list of all filters)
AllFilters = UnwrapElement(IN[0])

# Input 2: UsedFilters (list of used filters)
UsedFilters = UnwrapElement(IN[1])

# Create a boolean list: False for used filters, True for unused filters
BooleanList = [True if filter not in UsedFilters else False for filter in AllFilters]

# Output the boolean list indicating used (False) or unused (True) filters
OUT = BooleanList
# ----------------------------------------
filterByBoolMask = List.FilterByBoolMask(list=python_script, mask=python_script_2)
delete = Element.Delete(element=filterByBoolMask.in)
python_script_3 = Python(IN[0]=watch_2, IN[1]=watch_4)  # CPython3
# ---------- python_script_3.python (11 lines) ----------
# Input 1: AllFilters (list of all filters)
AllFilters = UnwrapElement(IN[0])

# Input 2: UsedFilters (list of used filters)
UsedFilters = UnwrapElement(IN[1])

# Find unused filters
UnusedFilters = [filter for filter in AllFilters if filter not in UsedFilters]

# Output the result
OUT = UnusedFilters
# ----------------------------------------
deleted_filters_which_are_unused = Watch(python_script_3)  # graph output
string = StringInput("Run the Script to Delete Filters which are not used in any Views")  # graph input
note = StringInput("Ignore the Issue Warnings")  # graph output
