# Dynamo graph Revit_DeleteAllCADFilesFromRevit.dyn "DeleteCADFilesFromRevit" (Dynamo 2.19.3.6394)

python_script = Python()  # CPython3; unwired: IN[0]
# ---------- python_script.python (15 lines) ----------
import clr
clr.AddReference('RevitServices')
from RevitServices.Persistence import DocumentManager

clr.AddReference('RevitAPI')
from Autodesk.Revit.DB import *

# Get the current Revit document
doc = DocumentManager.Instance.CurrentDBDocument

# Collect all ImportInstance elements (CAD files)
cad_elements = FilteredElementCollector(doc).OfClass(ImportInstance).ToElements()

# Output the collected elements
OUT = cad_elements
# ----------------------------------------
delete = Element.Delete(element=python_script)
deleted_cad_elements = Watch(delete)  # graph output
run_the_script = BoolSelector(true)  # graph input
