# Dynamo graph Revit_Export parameter Data to Excel.dyn "Export parameter Data to Excel" (Dynamo 2.19.3.6394)

code_block = CodeBlock { "Family and Type"; "Base Constraint"; "Width"; }
n1_choose_category = Categories("OST_Walls")  # "1. Choose Category"; graph input
all_elements_of_category = ElementsOfCategory(Category=n1_choose_category)
parameters = Element.Parameters(element=all_elements_of_category)
elementType = Element.ElementType(element=all_elements_of_category)
parameters_2 = Element.Parameters(element=elementType)
n0_choose_excel_file_path = Filename("C:\Users\User\Downloads\Export parameter Data.xlsx")  # "0. Choose Excel File Path"; graph input
code_block_2 = CodeBlock { "Sheet1"; }
code_block_3 = CodeBlock { 0; }
n1_instance_parameter_name = StringInput("Family and Type")  # "1. Instance Parameter Name"; graph input
n2_instance_parameter_name = StringInput("Base Constraint")  # "2. Instance Parameter Name"; graph input
n3_type_parameter_name = StringInput("Width")  # "3. Type Parameter Name"; graph input
code_block_4 = CodeBlock(A=n1_instance_parameter_name, B=n2_instance_parameter_name, C=n3_type_parameter_name) { [A,B,C]; }
getParameterValueByName = Element.GetParameterValueByName(element=all_elements_of_category, parameterName=n1_instance_parameter_name)

# group: Family Type
code_block_5 = CodeBlock(i=getParameterValueByName) { i.Name; }

watch = Watch(code_block_5)
getParameterValueByName_2 = Element.GetParameterValueByName(element=all_elements_of_category, parameterName=n2_instance_parameter_name)
watch_2 = Watch(getParameterValueByName_2)
getParameterValueByName_3 = Element.GetParameterValueByName(element=elementType, parameterName=n3_type_parameter_name)
watch_3 = Watch(getParameterValueByName_3)
list_create = List.Create(item0=watch, item1=watch_2, item2=watch_3)
transpose = List.Transpose(lists=list_create)
addItemToFront = List.AddItemToFront(item=code_block_4, list=transpose)
exportToExcel = Data.ExportToExcel(filePath=n0_choose_excel_file_path, sheetName=code_block_2, startRow=code_block_3, startColumn=code_block_3, data=addItemToFront)
