# Dynamo graph Revit_Find Restore Excluded Groups.dyn "Find Excluded Groups" (Dynamo 2.19.3.6394)
# packages: Crumple 2024.4.3

element_classes = ElementTypes("Group")
all_elements_of_class = ElementsOfType(element_class=element_classes)
groups_hasexclusions = Custom[© Groups.HasExclusions](groups=all_elements_of_class)  # package Crumple; Returns a boolean as to whether a group contains excluded elements.
filterByBoolMask = List.FilterByBoolMask(list=all_elements_of_class, mask=groups_hasexclusions)
code_block = CodeBlock(i=filterByBoolMask.in) { "Element Id: " + i.Id + " : " + i.Name; }
groups_which_has_excluded = Watch(code_block)  # "Groups which has excluded Elements"; graph output
code_block_2 = CodeBlock(i=filterByBoolMask.out) { i.Id + " : " + i.Name; }
watch = Watch(code_block_2)
packages_used = StringInput("1. Crumple")  # graph input
