# Dynamo graph Revit_Isolate PipeFlow from Source to Supply.dyn "4.2 Isolate PipeFlow Route" (Dynamo 2.19.3.6394)
# author: Ashik P M
# Isolate the flow of pipe from source to supply.
# packages: Crumple 2024.4.3

categories = Categories("OST_PipeCurves")
all_elements_of_category = ElementsOfCategory(Category=categories)
categories_2 = Categories("OST_PipeFitting")
all_elements_of_category_2 = ElementsOfCategory(Category=categories_2)
categories_3 = Categories("OST_PlumbingFixtures")
all_elements_of_category_3 = ElementsOfCategory(Category=categories_3)
categories_4 = Categories("OST_MechanicalEquipment")
all_elements_of_category_4 = ElementsOfCategory(Category=categories_4)
categories_5 = Categories("OST_PipeAccessory")
all_elements_of_category_5 = ElementsOfCategory(Category=categories_5)
list_create = List.Create(item0=all_elements_of_category, item1=all_elements_of_category_2, item2=all_elements_of_category_3, item3=all_elements_of_category_4, item4=all_elements_of_category_5)
flatten = List.Flatten(list=list_create)
code_block = CodeBlock { "_Code"; }
getParameterValueByName = Element.GetParameterValueByName(element=flatten, parameterName=code_block)

# group: Input
code = StringInput("1.11.11")  # graph input

# group: *
author = StringInput("Ashik P M")

python_script = Python(IN[0]=getParameterValueByName, IN[1]=code, IN[2]=author)  # CPython3
# ---------- python_script.python (25 lines) ----------
# Unwrapping inputs
input_list = IN[0]  # List of values
compare_value = IN[1]  # Single value to compare
ownership = IN[2]  # Ownership input

# Checking ownership
if "Ashik" not in ownership:
    OUT = None
else:
    # Splitting the compare_value into its segments
    compare_segments = compare_value.split('.')

    # Defining a function to check if the item matches or is a valid prefix
    def is_match(item, compare_value, compare_segments):
        if item == compare_value:
            return True
        item_segments = item.split('.')
        # Check if the item is a prefix of the compare_value
        return item_segments == compare_segments[:len(item_segments)]

    # Generating the Boolean list
    bool_list = [is_match(item, compare_value, compare_segments) for item in input_list]

    # Setting the output
    OUT = bool_list
# ----------------------------------------
filterByBoolMask = List.FilterByBoolMask(list=flatten, mask=python_script)
elements_isolate = Custom[© Elements.Isolate](elements=filterByBoolMask.in)  # package Crumple; Given a list of elements and a view (optional), will temporarily isolate them. If no view is provided, the active view will be used.
filterByBoolMask_2 = List.FilterByBoolMask(list=getParameterValueByName, mask=python_script)
