# Dynamo graph Revit_Line based Family Types.dyn "GIRDER ARRANGMENT" (Dynamo 2.18.1.5096)

file_path = Filename(".\U-GIRDER - TOP POINTS.csv")
boolean = BoolSelector(true)
importCSV = Data.ImportCSV(filePath=file_path, transpose=boolean)
code_block = CodeBlock { 1; }
dropItems = List.DropItems(list=importCSV, amount=code_block)
transpose = List.Transpose(lists=dropItems)

# group: Easting
code_block_2 = CodeBlock { 2; }
getItemAtIndex = List.GetItemAtIndex(list=transpose, index=code_block_2)

easting_base = CodeBlock { 606948.655; }
easting_easting_base = CodeBlock(E=getItemAtIndex, EB=easting_base) { E-EB; }

# group: Northing
code_block_3 = CodeBlock { 1; }
getItemAtIndex_2 = List.GetItemAtIndex(list=transpose, index=code_block_3)

northingBase = CodeBlock { 1200944.145; }
northing_northing_base = CodeBlock(N=getItemAtIndex_2, NB=northingBase) { N-NB; }

# group: Elevation
code_block_4 = CodeBlock { 3; }
getItemAtIndex_3 = List.GetItemAtIndex(list=transpose, index=code_block_4)

byCoordinates = Point.ByCoordinates(x=easting_easting_base, y=northing_northing_base, z=getItemAtIndex_3)
code_block_5 = CodeBlock { -1; }
dropItems_2 = List.DropItems(list=byCoordinates, amount=code_block_5)
code_block_6 = CodeBlock { 1; }
dropItems_3 = List.DropItems(list=byCoordinates, amount=code_block_6)
byStartPointEndPoint = Line.ByStartPointEndPoint(startPoint=dropItems_2, endPoint=dropItems_3)
levels = Levels("Level 1")

# group: family
code_block_7 = CodeBlock { 4; }
getItemAtIndex_4 = List.GetItemAtIndex(list=transpose, index=code_block_7)

byName = FamilyType.ByName(name=getItemAtIndex_4)
beamByCurve = StructuralFraming.BeamByCurve(curve=byStartPointEndPoint, level=levels, structuralFramingType=byName)
