# Dynamo graph Revit_List Views Which shows Underlay as some Value.dyn "List Views Which shows Underlay as some Value" (Dynamo 2.19.3.6394)
# author: Ashik P M
# Create Lists of Views contains Underlay values, which are in sheets and not on sheets.
# packages: Crumple 2024.4.3

collect_views = Custom[© Collect.Views]()  # package Crumple; Returns all views in a document. Excludes system views, templates, legends and schedule instances.
views_sheet = Custom[© Views.Sheet](views=collect_views)  # package Crumple; Returns the first sheet a view is found on, if any.
filterByBoolMask = List.FilterByBoolMask(list=collect_views, mask=views_sheet.isOnSheet)

# group: Underlay Base Level - sheet views
code_block = CodeBlock { "Range: Base Level"; }
getParameterValueByName = Element.GetParameterValueByName(element=filterByBoolMask.in, parameterName=code_block)

string_from_object = FromObject(object=getParameterValueByName)
flatten = List.Flatten(list=string_from_object)

# group: Author: Ashik P M
author = StringInput("Ashik P M")
packages_used = StringInput("1.  Crumple")  # graph input

python_script = Python(IN[0]=flatten, IN[1]=author)  # CPython3
# ---------- python_script.python (22 lines) ----------
# Get the input list
input_list = IN[0]

# Ownership string input
owner_string = IN[1]

# Ownership check
if "Ashik" not in owner_string:
    OUT = []  # Return an empty list if ownership is invalid
else:
    # Initialize an empty list for the output
    output = []

    # Iterate through the input list
    for value in input_list:
        if value == "None" or value == "":
            output.append(False)
        else:
            output.append(True)

    # Output the result
    OUT = output
# ----------------------------------------
filterByBoolMask_2 = List.FilterByBoolMask(list=filterByBoolMask.in, mask=python_script)
n1_views_on_the_sheet_which_has = Watch(filterByBoolMask_2.in)  # "1. Views on the Sheet Which has Underlay values"; graph output

# group: Underlay Base Level
code_block_2 = CodeBlock { "Range: Base Level"; }
getParameterValueByName_2 = Element.GetParameterValueByName(element=filterByBoolMask.out, parameterName=code_block_2)

string_from_object_2 = FromObject(object=getParameterValueByName_2)
flatten_2 = List.Flatten(list=string_from_object_2)
python_script_2 = Python(IN[0]=flatten_2, IN[1]=author)  # CPython3; same code as python_script
filterByBoolMask_3 = List.FilterByBoolMask(list=filterByBoolMask.out, mask=python_script_2)
n2_views_not_on_sheet_which_has = Watch(filterByBoolMask_3.in)  # "2. Views NOT on Sheet Which has Underlay values"; graph output
