# Dynamo graph Revit_List of Reference Planes in the Project and its Element ID.dyn "List of Reference Planes in the Project and its Element ID" (Dynamo 2.19.3.6394)
# author: Ashik P M
# Create Lists of Reference Planes which has Name and  No Name fileds. Delete Unnamed Reference Planes (Optional)

element_classes = ElementTypes("ReferencePlane")
all_elements_of_class = ElementsOfType(element_class=element_classes)
code_block = CodeBlock(i=all_elements_of_class) { i.Name; }
python_script = Python(IN[0]=code_block)  # CPython3
# ---------- python_script.python (8 lines) ----------
# Input: A list of strings connected to IN[0]
input_list = IN[0]

# Result: Generate True for values other than "Reference Plane", otherwise False
result = [False if item == "Reference Plane" else True for item in input_list]

# Output: The result
OUT = result
# ----------------------------------------
filterByBoolMask = List.FilterByBoolMask(list=code_block, mask=python_script)
id = Element.Id(element=all_elements_of_class)
filterByBoolMask_2 = List.FilterByBoolMask(list=id, mask=python_script)
code_block_2 = CodeBlock(X=filterByBoolMask.in, ID=filterByBoolMask_2.in) { X + ", " + ID; }
n1_list_reference_planes_with = Watch(code_block_2)  # "1. List Reference Planes With Names"; graph output
code_block_3 = CodeBlock(ID=filterByBoolMask_2.out) { ID; }
n2_list_reference_planes_with_no = Watch(code_block_3)  # "2. List Reference Planes With No Names"; graph output
filterByBoolMask_3 = List.FilterByBoolMask(list=all_elements_of_class, mask=python_script)
n1_delete_unnamed_reference = BoolSelector(true)  # "1. Delete Unnamed Reference Planes"; graph input

# group: Author : Ashik P M
n0_author = StringInput("Ashik P M")  # "0. Author:"
packages_used = StringInput("")

python_script_2 = Python(IN[0]=filterByBoolMask_3.out, IN[1]=n1_delete_unnamed_reference, IN[2]=n0_author)  # CPython3
# ---------- python_script_2.python (17 lines) ----------
# Input from Dynamo
input_list = IN[0]  # The list input
condition = IN[1]   # The boolean input
owner_string = IN[2]  # Ownership string input

# Ownership check
if "Ashik" not in owner_string:
    output = None  # Return None if ownership is invalid
else:
    # Logic to determine output
    if condition:
        output = input_list
    else:
        output = None

# Output to Dynamo
OUT = output
# ----------------------------------------
delete = Element.Delete(element=python_script_2)
flatten = List.Flatten(list=delete)
n3_deleted_reference_planes = Watch(flatten)  # "3.Deleted Reference Planes"; graph output
