# Dynamo graph Revit_Place Point based Family Types at Locations.dyn "Pile" (Dynamo 2.18.1.5096)

# group: Inputs
file_path = Filename(".\PILE POINTS.csv")
levels = Levels("Level 1")

boolean = BoolSelector(true)
importCSV = Data.ImportCSV(filePath=file_path, transpose=boolean)
code_block = CodeBlock { 1; }
dropItems = List.DropItems(list=importCSV, amount=code_block)
transpose = List.Transpose(lists=dropItems)
code_block_2 = CodeBlock { 3; }
elevation = List.GetItemAtIndex(list=transpose, index=code_block_2)
elevation_base = CodeBlock { 6.3610; }
code_block_3 = CodeBlock(EC=elevation, SC=elevation_base) { EC-SC; }

# group: Pile Family
code_block_4 = CodeBlock { 5; }
pile_type = List.GetItemAtIndex(list=transpose, index=code_block_4)

byName = FamilyType.ByName(name=pile_type)

# group: Easting Value
code_block_5 = CodeBlock { 2; }
easting = List.GetItemAtIndex(list=transpose, index=code_block_5)

easting_base = CodeBlock { 606948.655; }
code_block_6 = CodeBlock(EC=easting, SC=easting_base) { EC-SC; }

# group: Northing
code_block_7 = CodeBlock { 1; }
northing = List.GetItemAtIndex(list=transpose, index=code_block_7)

northing_base = CodeBlock { 1200944.145; }
code_block_8 = CodeBlock(EC=northing, SC=northing_base) { EC-SC; }
byCoordinates = Point.ByCoordinates(x=code_block_6, y=code_block_8, z=elevation)
byPointAndLevel = FamilyInstance.ByPointAndLevel(familyType=byName, point=byCoordinates, level=levels)
code_block_9 = CodeBlock { "Length"; }
code_block_10 = CodeBlock { 7; }
length = List.GetItemAtIndex(list=transpose, index=code_block_10)
setParameterByName = Element.SetParameterByName(element=byPointAndLevel, parameterName=code_block_9, value=length)
pilecap_diameter = List.GetItemAtIndex()  # frozen; unwired: list, index
code_block_11 = CodeBlock { 6; }
pile_no = List.GetItemAtIndex(list=transpose, index=code_block_11)  # frozen
code_block_12 = CodeBlock { 4; }
pilecap_length = List.GetItemAtIndex(list=transpose, index=code_block_12)  # frozen

# group: Manage Paramters
flatten = List.Flatten()  # unwired: list
string = StringInput("Pile Top Level")
setParameterByName_2 = Element.SetParameterByName(element=flatten, parameterName=string, value=elevation)  # frozen
string_2 = StringInput("Easting")
setParameterByName_3 = Element.SetParameterByName(element=flatten, parameterName=string_2, value=easting)  # frozen
string_3 = StringInput("Northing 2")
setParameterByName_4 = Element.SetParameterByName(element=flatten, parameterName=string_3, value=northing)  # frozen
string_4 = StringInput("Mark")
setParameterByName_5 = Element.SetParameterByName(element=flatten, parameterName=string_4, value=pile_no)
string_5 = StringInput("Pile Length")
setParameterByName_6 = Element.SetParameterByName(element=flatten, parameterName=string_5, value=pilecap_length)
