# Dynamo graph Revit_Rename Group Names from Excel Input.dyn "Check All Group Names & Standard" (Dynamo 2.19.3.6394)

string = StringInput("Sheet1")
boolean = BoolSelector(true)
n01_enter_csv_file_path = StringInput("C:\Users\User\Downloads\ashikl\For Dynamo.csv")  # "01. Enter CSV File Path"; graph input
element_classes = ElementTypes("Group")
all_elements_of_class = ElementsOfType(element_class=element_classes)
code_block = CodeBlock(i=all_elements_of_class) { i.Name; }
exportCSV = Data.ExportCSV(filePath=n01_enter_csv_file_path, data=code_block)
parameters = Element.Parameters(element=all_elements_of_class)
code_block_2 = CodeBlock { "Type Name"; }
elementType = Element.ElementType(element=all_elements_of_class)
parameters_2 = Element.Parameters(element=elementType)
importCSV = Data.ImportCSV(filePath=n01_enter_csv_file_path)
code_block_3 = CodeBlock { 1; }
getItemAtIndex = List.GetItemAtIndex(list=importCSV, index=code_block_3)
python_script = Python(IN[0]=all_elements_of_class, IN[1]=getItemAtIndex)  # CPython3
# ---------- python_script.python (39 lines) ----------
# Import necessary libraries
import clr
clr.AddReference('RevitAPI')
clr.AddReference('RevitServices')
from Autodesk.Revit.DB import *
from RevitServices.Persistence import DocumentManager
from RevitServices.Transactions import TransactionManager

# Get inputs
group_elements = UnwrapElement(IN[0])  # List of Group Elements
new_names = IN[1]  # List of updated names

# Initialize the output list
renamed_groups = []

# Get the current Revit document
doc = DocumentManager.Instance.CurrentUIApplication.ActiveUIDocument.Document

# Start a transaction
TransactionManager.Instance.EnsureInTransaction(doc)

# Loop through each group and rename its GroupType
for i, group in enumerate(group_elements):
    if i < len(new_names):
        try:
            # Access the GroupType and set its name
            group_type = group.GroupType
            group_type.Name = new_names[i]  # Renaming the GroupType, which is allowed
            renamed_groups.append(group)
        except Exception as e:
            renamed_groups.append(str(e))
    else:
        renamed_groups.append("No new name provided")

# Commit the transaction
TransactionManager.Instance.TransactionTaskDone()

# Output the renamed group elements
OUT = renamed_groups
# ----------------------------------------
updated_group_names = Watch(python_script)  # graph output
n00_stpes_to_execute_the_script = StringInput("""Step 1 : Create a CSV File and place it in a folder and copy the file Path

Step 2 : Enter File path at input 01.

Steps 3 : Run the Script

Step 4 : Open the CSV File and Add Updated Group names in the second Column

Step 5 : Run the Script again""")  # "00. Stpes to Execute the Script"; graph input
