# Dynamo graph Revit_Rooms_Dimensions_in Metric & Imperial Size.dyn "Rooms_Dimensions_in Metric & Imperial Size" (Dynamo 2.19.3.6394)

# group: Select Room Elements
categories = Categories("OST_Rooms")
choose_view = Views("Level 0")  # graph input
all_elements_of_category_in_view = ElementsOfCategoryInView(Category=categories, View=choose_view)

finishBoundary = Room.FinishBoundary(room=all_elements_of_category_in_view)
startPoint = Curve.StartPoint(curve=finishBoundary)

# group: StartPoint
X = Point.X(point=startPoint)
Y = Point.Y(point=startPoint)

endPoint = Curve.EndPoint(curve=finishBoundary)

# group: EndPoint
X_2 = Point.X(point=endPoint)
Y_2 = Point.Y(point=endPoint)

python_script = Python(IN[0]=X, IN[1]=Y, IN[2]=X_2, IN[3]=Y_2)  # CPython3
# ---------- python_script.python (35 lines) ----------
# Importing the necessary library for handling Revit elements
from Revit.Elements import *

# Unwrapping inputs directly from the IN variable
StartingX = (IN[0])
StartingY = (IN[1])
EndingX = (IN[2])
EndingY = (IN[3])

# Function to flatten nested lists
def flatten_list(nested_list):
    flat_list = []
    for sublist in nested_list:
        if isinstance(sublist, list):
            flat_list.extend(flatten_list(sublist))
        else:
            flat_list.append(sublist)
    return flat_list

# Combine corresponding starting and ending points and flatten all lists
combined_x = [flatten_list(start) + flatten_list(end) for start, end in zip(StartingX, EndingX)]
combined_y = [flatten_list(start) + flatten_list(end) for start, end in zip(StartingY, EndingY)]

# Function to find the maximum distance between parallel lines
def max_distance(coordinate_list):
    max_value = max(coordinate_list)
    min_value = min(coordinate_list)
    return round(abs(max_value - min_value), 2)

# Calculating the maximum distances for each room in X and Y directions
max_distances_x = [max_distance(coords) for coords in combined_x]
max_distances_y = [max_distance(coords) for coords in combined_y]

# Output the maximum distances for X and Y
OUT = [max_distances_x, max_distances_y]
# ----------------------------------------
code_block = CodeBlock { 0; 1; }

# group: Length
getItemAtIndex = List.GetItemAtIndex(list=python_script, index=code_block.out0)

string_from_object = FromObject(object=getItemAtIndex)

# group: Breadth
getItemAtIndex_2 = List.GetItemAtIndex(list=python_script, index=code_block.out1)

string_from_object_2 = FromObject(object=getItemAtIndex_2)
code_block_2 = CodeBlock(X=string_from_object, Y=string_from_object_2) { X + " X " + Y; }

# group: Set Meteric Size
code_block_3 = CodeBlock { "Metric Size"; }
python_script_2 = Python(IN[0]=code_block_2)  # CPython3
# ---------- python_script_2.python (14 lines) ----------
# Input data
Input1 = IN[0]

# Output container
OUT = []

for item in Input1:
    lengths = item.split(" X ")
    length = "{:.2f}".format(float(lengths[0]))
    breadth = "{:.2f}".format(float(lengths[1]))
    OUT.append(f"{length} X {breadth}")

# Output result
OUT = OUT
# ----------------------------------------

code_block_4 = CodeBlock(X=python_script_2) { X + "mm"; }

# group (continued): Set Meteric Size
setParameterByName = Element.SetParameterByName(element=all_elements_of_category_in_view, parameterName=code_block_3, value=code_block_4)

# group: Set Imperial Size
code_block_5 = CodeBlock { "Imperial Size"; }
python_script_3 = Python(IN[0]=python_script_2)  # CPython3
# ---------- python_script_3.python (22 lines) ----------
def mm_to_feet_and_single_digit_inches(mm):
    total_inches = mm * 0.0393701
    feet = int(total_inches // 12)
    inches = int(total_inches % 12)  # Only the whole number part of inches
    return f"{feet}' {inches}''"

# Input data
Input1 = IN[0]

# Output container
OUT = []

for item in Input1:
    lengths = item.split(" X ")
    length_mm = float(lengths[0])
    breadth_mm = float(lengths[1])
    length_feet_inches = mm_to_feet_and_single_digit_inches(length_mm)
    breadth_feet_inches = mm_to_feet_and_single_digit_inches(breadth_mm)
    OUT.append(f"{length_feet_inches} X {breadth_feet_inches}")

# Output result
OUT = OUT
# ----------------------------------------
setParameterByName_2 = Element.SetParameterByName(element=setParameterByName, parameterName=code_block_5, value=python_script_3)
