# Dynamo graph Revit_Save all Titleblocks Families.dyn "Save all Titleblocks from Revit Project to a Folder" (Dynamo 2.19.3.6394)
# packages: Clockwork for Dynamo 2.x 2.3.0

current = Document.Current()
categories = Categories("OST_TitleBlocks")
all_family_types_of_category = Custom[All Family Types Of Category](category=categories)  # package Clockwork for Dynamo 2.x; Gets all family types/symbols of a given category in the model.
saved_families = FamilyType.Family(familyType=all_family_types_of_category)  # graph output
enter_folder_path_to_save_rfa = StringInput("C:\Users\User\Downloads\ashikl")  # "Enter Folder path to Save .Rfa File"; graph input
saveFamilyToFolder = Document.SaveFamilyToFolder(document=current, family=saved_families, directoryPath=enter_folder_path_to_save_rfa)
saved_families_2 = Watch(saved_families)  # graph output
