# Dynamo graph Revit_Verify Grids & Levels are monitored.dyn "Verify Grids & Levels are monitored" (Dynamo 2.19.3.6394)
# packages: Orchid 2.19.3.6373

# group: Check Grids are monitored
element_classes = ElementTypes("Grid")
all_elements_of_class = ElementsOfType(element_class=element_classes)
isCopyMonitored = Orchid.RevitProject.Elements.Element.IsCopyMonitored(element=all_elements_of_class)
filterByBoolMask = List.FilterByBoolMask(list=all_elements_of_class, mask=isCopyMonitored)
n1_3_ids_of_grids_which_are_not = Element.Id(element=filterByBoolMask.out)  # "1.3. IDs of Grids which are not monitored"
n1_2_no_of_grids_which_are_not = List.Count(list=n1_3_ids_of_grids_which_are_not)  # "1.2. No. of Grids which are not monitored"; graph output
n1_1_total_number_of_grids = List.Count(list=all_elements_of_class)  # "1.1 Total Number of Grids"; graph output
code_block = CodeBlock { "Name"; }
getParameterValueByName = Element.GetParameterValueByName(element=filterByBoolMask.out, parameterName=code_block)
code_block_2 = CodeBlock(name=getParameterValueByName, ID=n1_3_ids_of_grids_which_are_not) { "Grid Name: " + name + " / " +"Element ID: " + ID; }
n1_3_ids_of_grids_which_are_not_2 = Watch(code_block_2)  # "1.3. IDs of Grids which are NOT monitored"; graph output

# group: Check Levels are monitored
element_classes_2 = ElementTypes("Level")
all_elements_of_class_2 = ElementsOfType(element_class=element_classes_2)
isCopyMonitored_2 = Orchid.RevitProject.Elements.Element.IsCopyMonitored(element=all_elements_of_class_2)
filterByBoolMask_2 = List.FilterByBoolMask(list=all_elements_of_class_2, mask=isCopyMonitored_2)
n2_3_ids_of_levels_which_are_not = Element.Id(element=filterByBoolMask_2.out)  # "2.3. IDs of Levels which are not monitored"
n2_2_no_of_levels_which_are_not = List.Count(list=n2_3_ids_of_levels_which_are_not)  # "2.2 No. of Levels which are not monitored"; graph output
n2_1_total_number_of_levels = List.Count(list=all_elements_of_class_2)  # "2.1. Total Number of Levels"; graph output
code_block_3 = CodeBlock { "Name"; }
getParameterValueByName_2 = Element.GetParameterValueByName(element=filterByBoolMask_2.out, parameterName=code_block_3)
n2_3_ids_of_levels_which_are_not_2 = CodeBlock(name=getParameterValueByName_2, ID=n2_3_ids_of_levels_which_are_not) { "Level Name: " + name + " / " + "Element ID: " + ID; }  # "2.3. IDs of Levels which are not monitored"
n2_3_ids_of_levels_which_are_not_3 = Watch(n2_3_ids_of_levels_which_are_not_2)  # "2.3. IDs of Levels which are NOT monitored"; graph output

code_block_4 = CodeBlock {  }
